# Grasshopper definition transfinite.gh (Grasshopper 1.0.7)
# plug-ins: Transfinite

u_scale = U_scale(40)
number_slider = Slider(100, range=0..100)
number_slider_2 = Slider(500, range=0..1000)
number_slider_3 = Slider(100, range=0..100)
nickname = Transfinite(U=0, V=0, U_scale=number_slider_3, V_scale=number_slider_3, N=3)  # -> Curves, DomainPolygon, Landa, Kappa, Nu, Kato, Kato_pointlist, Patches, PlnError
crv = Curve(nickname.Curves)
crv_2 = Curve(nickname.DomainPolygon)
pt = Point(nickname.Kato_pointlist)
item = ListItem(List=crv, Index=Slider(10, range=0..10), Wrap=True)
srfgrid = SurfaceFromPoints(Points=nickname.Kato_pointlist, UCount=expr("x+1", number_slider_3), Interpolate=False)
end = EndPoints(Curve=item)  # -> Start, End
preview = CustomPreview(
    Geometry=srfgrid,
    Material={diffuse=RGB(221, 160, 221), emission=RGB(66, 48, 66), shine=0.5, specular=RGB(255, 255, 255), transparency=0})  # disabled
panel = Panel()
pt_2 = Point(end.Start)
pt_3 = Point(Point(1.190148824, 1.408117145, 0))
panel_2 = Panel(pt_3)
partition = PartitionList(List=panel, Size=Slider(6, range=0..10))
bang = ExplodeTree(Data=partition)  # -> Branch0, Branch1, Branch2, Branch3
item_2 = ListItem(List=panel_2, Index=0, Wrap=True)
ma = MassAddition(Input=bang.Branch3)  # -> Result, PartialResults
panel_3 = Panel(ma.Result)
panel_4 = Panel(bang.Branch0)
panel_5 = Panel(item_2)
end_2 = EndPoints(Curve=crv_2)  # -> Start, End
item_3 = ListItem(Index=0, Wrap=True)
multiplication = Multiplication(A=end_2.Start, B=panel_4)
ma_2 = MassAddition(Input=multiplication)  # -> Result, PartialResults
panel_6 = Panel(ma_2.Result)
pt_4 = Point(ma_2.Result)
